% Simulink data dictionary Rotor.sldd

RT_BladeFlapInertia_P = Simulink.Parameter(2500, Min=10, Max=10000, Unit="kgf")  % Blade flapping moment of inertia in the general rotor
Sig = Simulink.Signal()
RT_BladeLeadInertia_P = Simulink.Parameter(3000, Min=6, Max=1000)
RT_BEDistFromEffSta_A = Simulink.Parameter([0.05; 0.1; 0.15; 0.2; 0.25; 0.3; 0.35; 0.4; 0.45; 0.5; 0.55; 0.6; 0.65; 0.7; 0.75; 0.8; 0.85; 0.9; 0.95; 1], Min=0, Max=1, Unit="nA")  % Distance from each blade element to the root, these blade element is aerodynamically significant.
RT_RotorRadius_P = Simulink.Parameter(7.82, Min=5, Max=10, Unit="m")  % General rotor radisu
RT_BEDistFromHinge_A = Simulink.Parameter([0.05; 0.1; 0.15; 0.2; 0.25; 0.3; 0.35; 0.4; 0.45; 0.5; 0.55; 0.6; 0.65; 0.7; 0.75; 0.8; 0.85; 0.9; 0.95; 1], Unit="nA")  % Distance from each blade element to the root, these blade element is aerodynamically significant.
RT_BEMassFromHinge_A = Simulink.Parameter(repmat(5.9, 20, 1), Unit="kg")  % Mass for each blade element counted from the hinge
RT_HingeFlapPos_P = Simulink.Parameter(0.05, Min=0, Max=0.1, Unit="nA")  % Ratio distance of the hinge from the center